# Grasshopper definition Dome.gh (Grasshopper 1.0.7)

radius = Slider(40, range=0..50)
up_or_down = Slider(0, range=0..1)
height = Slider(1.19, range=0..2)
shape_factor = Slider(13, range=0..40)
arrangement_of_cols = Slider(5, range=0..39)
section_lengths = Slider(0, range=0..1)
no_of_columns = Slider(18, range=0..39)
colour = ColourSwatch(SwatchColor=RGB(159, 209, 209))
rect_size = Slider(5, range=5..100)
rect_size_2 = Slider(5, range=5..100)
rectangle = Rectangle(Plane=PlaneXY(0, 0, 0), XSize=rect_size, YSize=rect_size_2, Radius=0)  # -> Rectangle, Length
sphere = Sphere(Base=PlaneXY(0, 0, 0), Radius=radius)
circle = Circle(Plane=PlaneXY(0, 0, 0), Radius=radius)
input_section = Geometry(rectangle.Rectangle)
divide_curve = DivideCurve(Curve=circle, Count=shape_factor, Kinks=False)  # -> Points, Tangents, Parameters
brep_brep = BrepBrep(BrepA=sphere, BrepB=circle)  # -> Curves, Points
list_item = ListItem(List=divide_curve.Points, Index=0, Wrap=True)
list_item_2 = ListItem(List=divide_curve.Points, Index=arrangement_of_cols, Wrap=True)
surface_split = SurfaceSplit(Surface=sphere, Curves=brep_brep.Curves)
line = Line(StartPoint=list_item, EndPoint=list_item_2)
list_item_3 = ListItem(List=surface_split, Index=up_or_down, Wrap=True)
scale_nu = ScaleNU(Geometry=list_item_3, Plane=PlaneXY(0, 0, 0), ScaleX=1, ScaleY=1, ScaleZ=height)  # -> Geometry, Transform
kaleidoscope = Kaleidoscope(Geometry=line, Plane=PlaneXY(0, 0, 0), Segments=no_of_columns)  # -> Geometry, Transform
project = Project(Curve=kaleidoscope.Geometry, Brep=scale_nu.Geometry, Direction=Vector(0, 0, 1))
perp_frame = PerpFrame(Curve=reparameterize(project), Parameter=section_lengths)
area = Area(Geometry=input_section)  # -> Area, Centroid
orient = Orient(Geometry=input_section, Source=area.Centroid, Target=perp_frame)  # -> Geometry, Transform
sweep1 = Sweep1(Rail=project, Sections=orient.Geometry, Miter=1)
custom_preview = CustomPreview(Geometry=sweep1, Material=colour)
