# Grasshopper definition Industrial Hall.gh (Grasshopper 1.0.7)

span_distance = Slider(9, range=4..10)
spans = Slider(5, range=1..20)
midheight = Slider(17, range=6..45)
width = Slider(5, range=2..20)
height = Slider(9, range=2..20)

X = Slider(36, range=2..100)
Y = Slider(30, range=2..100)
Z = Slider(24, range=2..100)
construct_point = ConstructPoint(XCoordinate=X, YCoordinate=Y, ZCoordinate=Z)
addition = Addition(A=Z, B=height)
addition_2 = Addition(A=X, B=width)
construct_point_2 = ConstructPoint(XCoordinate=X, YCoordinate=Y, ZCoordinate=addition)
addition_3 = Addition(A=Z, B=midheight)
division = Division(A=addition_2, B=Slider(2, range=0..10))
construct_point_3 = ConstructPoint(XCoordinate=division, YCoordinate=Y, ZCoordinate=addition_3)
line = Line(StartPoint=construct_point, EndPoint=construct_point_2)
yz_plane = YZPlane(Origin=construct_point_3)
construct_plane = ConstructPlane(Origin=yz_plane, XAxis="{0,1,0}", YAxis="{0,0,1}")
line_2 = Line(StartPoint=construct_point_2, EndPoint=construct_point_3)
mirror = Mirror(Geometry=[construct_point_2, line, line_2, construct_point], Plane=construct_plane)  # -> Geometry, Transform
unit_y = UnitY(Factor=span_distance)
linear_array = LinearArray(
    Geometry=[mirror.Geometry, line_2, line, construct_point_3, construct_point_2, construct_point],
    Direction=unit_y,
    Count=spans)  # -> Geometry, Transform
