# Grasshopper definition Zaha Hadid SOHO.gh (Grasshopper 1.0.7)

no_of_floors = Slider(20, range=2..40)
center_shift = Slider(0.9, range=0..1)
center_scale = Slider(0.7, range=0..1)
p1 = Slider(1.16, range=0..2)
p2 = Slider(1.56, range=0..2)
pt = Point(Point(0, 0, 0))
no_of_floors_2 = Slider(20, range=2..40)
center_shift_2 = Slider(0.9, range=0..1)
p1_2 = Slider(1.16, range=0..2)
center_scale_2 = Slider(0.7, range=0..1)
p2_2 = Slider(1.56, range=0..2)
pt_2 = Point(Point(-1.032399641, -148.7710597, 0))
base_form_1 = BaseForm1(
    P=pt,
    r1=Slider(32, range=31..100),
    r2=Slider(49, range=5..100),
    A=Slider(0, range=0..180),
    B=Slider(55.04, range=0..100),
    no_of_floors=no_of_floors,
    center_shift=center_shift,
    center_scale=center_scale,
    A_2=p1,
    B_2=p2)  # -> G, G_2
base_form_1_2 = BaseForm1_2(
    P=pt_2,
    r1=Slider(32, range=31..100),
    r2=Slider(33, range=5..100),
    A=Slider(90, range=0..180),
    B=Slider(55.04, range=0..100),
    no_of_floors=no_of_floors_2,
    center_shift=center_shift_2,
    center_scale=center_scale_2,
    A_2=p1_2,
    B_2=p2_2)  # -> G, G_2
h1 = Slider(9, range=0..15)
r_size = Slider(0.92, range=0..2)
h1_2 = Slider(9, range=0..15)
r_size_2 = Slider(0.92, range=0..2)
crv_r = CRVR(
    crv_2=base_form_1.G,
    crv=base_form_1.G_2,
    relay_2=h1,
    relay=r_size,
    N=Slider(15, range=0..100),
    A=Slider(1.29, range=0..10))
wall_thickness = Slider(1.01, range=0..10)
wall_offset = Slider(1.179, range=1..1.5)
crv_r_2 = CRVR(
    crv_2=base_form_1_2.G,
    crv=base_form_1_2.G_2,
    relay_2=h1_2,
    relay=r_size_2,
    N=Slider(15, range=0..100),
    A=Slider(1.29, range=0..10))
wall_offset_2 = Slider(1.179, range=1..1.5)
wall_thickness_2 = Slider(1.01, range=0..10)
cluster = Cluster(crv_b1=base_form_1.G, crv_b2=base_form_1.G_2, F=wall_offset, crv_r=crv_r, F_2=wall_thickness, R=Slider(0.32, range=0..1))  # -> E, L_2, P, L
cluster_2 = Cluster(
    crv_b1=base_form_1_2.G,
    crv_b2=base_form_1_2.G_2,
    F=wall_offset_2,
    crv_r=crv_r_2,
    F_2=wall_thickness_2,
    R=Slider(0.32, range=0..1))  # -> E, L_2, P, L
direction_flip = BooleanToggle(False)
parameter_1 = Slider(0.61, range=0.05..1)
parameter_2 = Slider(0.2, range=0.05..1)
number_slider = Slider(36, range=5..50)
direction_flip_2 = BooleanToggle(True)
flip_1 = BooleanToggle(False)
flip_2 = BooleanToggle(True)
crv = Curve(base_form_1.G_2)
crv_2 = Curve(base_form_1_2.G_2)
parameter_1_2 = Slider(0.91, range=0.05..1)
parameter_2_2 = Slider(0.8, range=0.05..1)
number_slider_2 = Slider(48, range=5..50)
number_slider_3 = Slider(37, range=5..50)
number_slider_4 = Slider(50, range=5..50)
crv_1 = Crv1(
    L=crv,
    S=Slider(5, range=0..10),
    C=Slider(8, range=0..10),
    L_2=crv_2,
    parameter=parameter_1_2,
    parameter_2=parameter_2_2,
    relay=number_slider_2,
    relay_4=number_slider_3,
    relay_8=direction_flip,
    parameter_1=parameter_1,
    parameter_2_2=parameter_2,
    relay_3=number_slider,
    relay_2=number_slider_4,
    relay_7=direction_flip_2,
    relay_5=flip_1,
    relay_6=flip_2)  # -> C_2, C_3, i, i_2
offset_fix = BooleanToggle(False)
floor_thickness = Slider(0.46, range=0..1)
offset = Slider(0.39, range=0..10)
cluster_3 = Cluster_2(
    crv=crv_1.C_2,
    crv_2=crv_1.C_3,
    crv_3=crv_1.i,
    crv_4=crv_1.i_2,
    floor_thickness=floor_thickness,
    G=offset_fix,
    offset=offset)  # -> E, L, L_2

# ==== cluster BaseForm1
P = ClusterInput()
r1 = ClusterInput()
r2 = ClusterInput()
A = ClusterInput()
B = ClusterInput()
no_of_floors = ClusterInput()
center_shift = ClusterInput()
center_scale = ClusterInput()
A_2 = ClusterInput()
B_2 = ClusterInput()

ellipse = Ellipse(Plane=P, Radius1=r1, Radius2=r2)  # -> Ellipse, Focus1, Focus2
dom = ConstructDomain(DomainStart=0, DomainEnd=B)
range = Range(Domain=dom, Steps=no_of_floors)
Z = UnitZ(Factor=range)

# ----
# Base Form 1
rotate = Rotate(Geometry=ellipse.Ellipse, Angle=degrees(A), Plane=P)  # -> Geometry, Transform

move = Move(Geometry=rotate.Geometry, Motion=Z)  # -> Geometry, Transform

range_2 = Range(Domain=Domain(0, 1), Steps=no_of_floors)
# Transform 1 (Outer Cover)
graph = GraphMapper(
    range_2,
    x0=0,
    x1=1,
    y0=0,
    y1=1,
    container_name="Bezier",
    cpx=[0, 0.1369810253, 0.9901885986, 1],
    cpy=[0.2227331996, 0.6527537107, 1, 0.1826149821])
dom_2 = ConstructDomain(DomainStart=A_2, DomainEnd=B_2)
bnd = Bounds(Numbers=graph)
area = Area(Geometry=move.Geometry)  # -> Area, Centroid
remap = RemapNumbers(Value=graph, Source=bnd, Target=dom_2)  # -> Mapped, Clipped
scale = Scale(Geometry=move.Geometry, Center=area.Centroid, Factor=remap.Mapped)  # -> Geometry, Transform

curvepoint = PointOnCurve(move.Geometry, parameter=0.75)
curvepoint_2 = PointOnCurve(move.Geometry, parameter=0.25)
# Transform 2 (Open Down)
ln = Line(StartPoint=curvepoint, EndPoint=curvepoint_2)
eval = EvaluateCurve(Curve=ln, Parameter=center_shift)  # -> Point, Tangent, Angle
scale_2 = Scale(Geometry=move.Geometry, Center=eval.Point, Factor=center_scale)  # -> Geometry, Transform

G = ClusterOutput(scale_2.Geometry)
G_2 = ClusterOutput(scale.Geometry)

# ==== cluster CRVR
crv = ClusterInput()
crv_2 = ClusterInput()
relay = ClusterInput()
relay_2 = ClusterInput()
N = ClusterInput()
A = ClusterInput()

crv_3 = Curve(crv)
crv_4 = Curve(crv_2)
item = ListItem(List=reverse(crv_4), Index=0, Wrap=True)
Z = UnitZ(Factor=relay_2)
item_2 = ListItem(List=reverse(crv_3), Index=0, Wrap=True)
move = Move(Geometry=item, Motion=Z)  # -> Geometry, Transform
area = Area(Geometry=move.Geometry)  # -> Area, Centroid
# Roof Cover
scale = Scale(Geometry=move.Geometry, Center=area.Centroid, Factor=relay)  # -> Geometry, Transform
range = Range(Domain=Domain(0, 1), Steps=N)
graph = GraphMapper(
    range,
    x0=0,
    x1=1,
    y0=0,
    y1=1,
    container_name="Bezier",
    cpx=[0, 0.03274988383, 1, 1],
    cpy=[0, 0.5718357563, 0.5494974852, 0.1390339732])
dom = ConstructDomain(DomainStart=A, DomainEnd="1.00")
tweencrv = TweenCurve(CurveA=scale.Geometry, CurveB=item_2, Factor=range, BlendType=0)
area_2 = Area(Geometry=tweencrv)  # -> Area, Centroid
bnd = Bounds(Numbers=graph)
remap = RemapNumbers(Value=graph, Source=bnd, Target=dom)  # -> Mapped, Clipped
scale_2 = Scale(Geometry=tweencrv, Center=area_2.Centroid, Factor=remap.Mapped)  # -> Geometry, Transform
G = ClusterOutput(scale_2.Geometry)

# ==== cluster Cluster
crv_b2 = ClusterInput()
crv_r = ClusterInput()
crv_b1 = ClusterInput()
loft = Loft(Curves=crv_b2, Options={Adjust=False, Closed=False, LoftEnds=0, LoftSimp=0, LoftType=0, Rebuild=10, Refit=0.01})
F = ClusterInput()
L = ClusterOutput(loft)
R = ClusterInput()

# ---- group: R Loft
item = ListItem(List=reverse(crv_b1), Index=0, Wrap=True)
loft_2 = Loft(Curves=[item, crv_r], Options={Adjust=False, Closed=False, LoftEnds=0, LoftSimp=0, LoftType=0, Rebuild=10, Refit=0.01})

# ----
pipe = Pipe(Curve=crv_r, Radius=R, Caps=0)
F_2 = ClusterInput()

area = Area(Geometry=crv_b2)  # -> Area, Centroid
scale = Scale(Geometry=crv_b2, Center=area.Centroid, Factor=F)  # -> Geometry, Transform
boundary = BoundarySurfaces(Edges=[crv_b1, scale.Geometry])
Z = UnitZ(Factor=F_2)
extr = Extrude(Base=boundary, Direction=Z)

E = ClusterOutput(extr)
L_2 = ClusterOutput(loft_2)
P = ClusterOutput(pipe)

# ==== cluster BaseForm1_2
P = ClusterInput()
r1 = ClusterInput()
r2 = ClusterInput()
no_of_floors = ClusterInput()
A = ClusterInput()
B = ClusterInput()
center_shift = ClusterInput()
center_scale = ClusterInput()
A_2 = ClusterInput()
B_2 = ClusterInput()

ellipse = Ellipse(Plane=P, Radius1=r1, Radius2=r2)  # -> Ellipse, Focus1, Focus2
dom = ConstructDomain(DomainStart=0, DomainEnd=B)
range = Range(Domain=dom, Steps=no_of_floors)
Z = UnitZ(Factor=range)

# ----
# Base Form 1
rotate = Rotate(Geometry=ellipse.Ellipse, Angle=degrees(A), Plane=P)  # -> Geometry, Transform

move = Move(Geometry=rotate.Geometry, Motion=Z)  # -> Geometry, Transform

range_2 = Range(Domain=Domain(0, 1), Steps=no_of_floors)
# Transform 1 (Outer Cover)
graph = GraphMapper(
    range_2,
    x0=0,
    x1=1,
    y0=0,
    y1=1,
    container_name="Bezier",
    cpx=[0, 0.1369810253, 0.9901885986, 1],
    cpy=[0.2227331996, 0.6527537107, 1, 0.1826149821])
dom_2 = ConstructDomain(DomainStart=A_2, DomainEnd=B_2)
bnd = Bounds(Numbers=graph)
area = Area(Geometry=move.Geometry)  # -> Area, Centroid
remap = RemapNumbers(Value=graph, Source=bnd, Target=dom_2)  # -> Mapped, Clipped
scale = Scale(Geometry=move.Geometry, Center=area.Centroid, Factor=remap.Mapped)  # -> Geometry, Transform

curvepoint = PointOnCurve(move.Geometry, parameter=0.755)
curvepoint_2 = PointOnCurve(move.Geometry, parameter=0.248)
# Transform 2 (Open Down)
ln = Line(StartPoint=curvepoint, EndPoint=curvepoint_2)
eval = EvaluateCurve(Curve=ln, Parameter=center_shift)  # -> Point, Tangent, Angle
scale_2 = Scale(Geometry=move.Geometry, Center=eval.Point, Factor=center_scale)  # -> Geometry, Transform

G = ClusterOutput(scale_2.Geometry)
G_2 = ClusterOutput(scale.Geometry)

# ==== cluster Crv1
S = ClusterInput()
C = ClusterInput()
series = Series(Start=S, Step=1, Count=C)
L = ClusterInput()
L_2 = ClusterInput()
item = ListItem(List=L, Index=series, Wrap=True)
item_2 = ListItem(List=L_2, Index=series, Wrap=True)
parameter_2 = ClusterInput()
parameter_1 = ClusterInput()
parameter_2_2 = ClusterInput()
parameter = ClusterInput()
relay = ClusterInput()
relay_2 = ClusterInput()
relay_3 = ClusterInput()
relay_4 = ClusterInput()
crv = Curve(item)
crv_2 = Curve(item_2)
relay_5 = ClusterInput()
relay_6 = ClusterInput()
shatter = Shatter(Curve=reparameterize(crv), Parameters=[parameter_1, parameter])
shatter_2 = Shatter(Curve=reparameterize(crv_2), Parameters=[parameter_2_2, parameter_2])
eval = EvaluateCurve(Curve=reparameterize(item_2), Parameter=parameter_2_2)  # -> Point, Tangent, Angle
eval_2 = EvaluateCurve(Curve=reparameterize(item), Parameter=parameter_1)  # -> Point, Tangent, Angle
eval_3 = EvaluateCurve(Curve=reparameterize(item_2), Parameter=parameter_2)  # -> Point, Tangent, Angle
eval_4 = EvaluateCurve(Curve=reparameterize(item), Parameter=parameter)  # -> Point, Tangent, Angle
item_3 = ListItem(List=shatter_2, Index=relay_6, Wrap=True)
item_4 = ListItem(List=shatter, Index=relay_5, Wrap=True)
relay_7 = ClusterInput()
relay_8 = ClusterInput()
multiplication = Multiplication(A=eval_2.Tangent, B=relay_3)
multiplication_2 = Multiplication(A=eval.Tangent, B=relay_2)
multiplication_3 = Multiplication(A=eval_4.Tangent, B=relay)
multiplication_4 = Multiplication(A=eval_3.Tangent, B=relay_4)

neg = Negative(Value=multiplication)
filter = StreamFilter(Gate=relay_7, Stream0=multiplication, Stream1=neg)

neg_2 = Negative(Value=multiplication_2)
filter_2 = StreamFilter(Gate=relay_7, Stream0=multiplication_2, Stream1=neg_2)

neg_3 = Negative(Value=multiplication_3)
filter_3 = StreamFilter(Gate=relay_8, Stream0=multiplication_3, Stream1=neg_3)

neg_4 = Negative(Value=multiplication_4)
filter_4 = StreamFilter(Gate=relay_8, Stream0=multiplication_4, Stream1=neg_4)

bzspan = BezierSpan(StartPoint=eval_2.Point, StartTangent=expr("-x", filter), EndPoint=eval.Point, EndTangent=filter_2)  # -> Curve, Length, Domain
bzspan_2 = BezierSpan(StartPoint=eval_4.Point, StartTangent=expr("-x", filter_3), EndPoint=eval_3.Point, EndTangent=filter_4)  # -> Curve, Length, Domain
C_2 = ClusterOutput(bzspan_2.Curve)
C_3 = ClusterOutput(bzspan.Curve)
i = ClusterOutput(item_4)
i_2 = ClusterOutput(item_3)

# ==== cluster Cluster_2
crv = ClusterInput()
crv_2 = ClusterInput()
crv_3 = ClusterInput()
crv_4 = ClusterInput()
crv_5 = Curve(flatten(crv))
crv_6 = Curve(flatten(crv_2))
crv_7 = Curve(flatten(crv_3))
crv_8 = Curve(flatten(crv_4))
floor_thickness = ClusterInput()
offset = ClusterInput()
neg = Negative(Value=offset)
G = ClusterInput()
boundary = BoundarySurfaces(Edges=[crv_5, crv_7, crv_8, crv_6])
filter = StreamFilter(Gate=G, Stream0=offset, Stream1=neg)
offsets = OffsetOnSrf(Curve=crv_5, Distance=filter, Surface=boundary)
offsets_2 = OffsetOnSrf(Curve=crv_6, Distance=expr("-x", filter), Surface=boundary)
Z = UnitZ(Factor=floor_thickness)
loft = Loft(
    Curves=flatten(offsets),
    Options={Adjust=False, Closed=False, LoftEnds=0, LoftSimp=0, LoftType=0, Rebuild=10, Refit=0.01})
loft_2 = Loft(
    Curves=flatten(offsets_2),
    Options={Adjust=False, Closed=False, LoftEnds=0, LoftSimp=0, LoftType=0, Rebuild=10, Refit=0.01})
extr = Extrude(Base=boundary, Direction=Z)
E = ClusterOutput(extr)
L = ClusterOutput(loft)
L_2 = ClusterOutput(loft_2)
